# Grasshopper definition quadtree.gh (Grasshopper 0.9.76)
# plug-ins: Python Interpreter

rec = Rectangle({Plane=PlaneXY(-10, -10, 0), Size=Domain2(u=0..20, v=0..20)})
series = Series(Start=0, Step=1, Count=10)
pop2d = Populate2D(Region=rec, Count=100, Seed=1)
Z = UnitZ(Factor=series)
move = Move(Geometry=graft(pop2d), Motion=Z)  # -> Geometry, Transform
panel = Panel(move.Geometry)
python = PythonScript()  # -> out, a; inputs rectangle: Curve, points: list of Point3d; disabled
# ---------- python: Python ----------
# sample script to show how to use this component and the rhinoscriptsyntax
"""Constructs a sinusoidal series of circles.
  Inputs:
    x: The number of circles. (integer)
    y: The radius of each circle. (float)
  Outputs:
    a: The list of circles. (list of circle)
    b: The list of radii. (list of float)
"""
import math
import rhinoscriptsyntax as rs

if x is None:
    x = 24    # if nothing is connected to x, set x to something (24).
if y is None:
    y = 0.3    # if nothing is connected to y, set y to 0.3.

circles = []            # create a list. We will add IDs to it later on.
radii = []              # ...and create another one.

for i in range(int(x)):
    pt = (i, math.cos(i), 0)             # a tuple (here for a point).
    id1 = rs.AddCircle(pt, y)
    circles.append(id1)
    endPt = rs.PointAdd(pt, (0, 0.3, 0)) # move the point by the vector.
    id2 = rs.AddLine(pt, endPt)
    radii.append(id2)

a = circles
b = radii
# ---------- end python ----------
c_script = CSharpScript(x=simplify(move.Geometry))  # -> out, A; inputs x: tree
# ---------- c_script: C# ----------
    //Print(x.Branch().ToString());
    A = x.Branch(1);
# ---------- end c_script ----------
c_script_2 = CSharpScript(rectangle=rec, points=pop2d)  # -> out, A, B; inputs rectangle: Rectangle3d, points: list of Point3d
# ---------- c_script_2: C# ----------
    List<Point3d> temp4points = new List<Point3d>();
    for(int i = 0; i < 4; i++){
      temp4points.Add(rectangle.Corner(i));
    }
    //A = temp4points;

    List < Rectangle3d > RecList = new List<Rectangle3d>();

    foreach(Point3d pt in temp4points ){
      Print(pt.ToString());
      Rectangle3d TempRec = new Rectangle3d();
      Transform scaling = new Transform();

      TempRec = rectangle;
      scaling = Transform.Scale(pt, 0.5);
      //RecList.Add(TempRec.Transform(scaling));
      TempRec.Transform(scaling);
      RecList.Add(TempRec);
    }

    List < Point3d > PtList = new List<Point3d>();
    DataTree<Point3d> Tree = new DataTree<Point3d>();

    foreach(Rectangle3d TempRec in RecList){
      foreach(Point3d pt in points){
        
        if(TempRec.Contains(pt).ToString() == "Inside"){
          PtList.Add(pt);
          Tree.Add(PtList);

        }
      }
    }




    A = PtList;
    B = RecList;
# ---------- end c_script_2 ----------
panel_2 = Panel(c_script.out)
panel_3 = Panel(c_script_2.out)
panel_4 = Panel(c_script_2.A)
panel_5 = Panel(c_script_2.B)
